# Grasshopper definition colored_mesh_to_json_v3.gh (Grasshopper 1.0.7)

brep = Brep(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)
brep_2 = Brep(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)
mbox = MeshBox(Base=brep_2, XCount=10, YCount=10, ZCount=10)
mesh = Mesh(brep)
c_script = CSharpScript(mesh=mbox)  # -> colored_mesh; inputs mesh: Mesh
# ---------- c_script: C# ----------
    for(int i = 0; i < mesh.Vertices.Count; i++)
    {
      int red = i % 255;
      int green = 0;
      if( i % 10 == 0 )
        green = 255;
      int blue = 255 - red;
      mesh.VertexColors.Add(red, green, blue);
    }
    colored_mesh = mesh;
# ---------- end c_script ----------
scale = Scale(Geometry=c_script, Center=Point(0, 0, 0), Factor=Slider(0.1, range=0..0.1))  # -> Geometry, Transform
yz = YZPlane(Origin=Point(0, 0, 0))
rotate = Rotate(Geometry=scale.Geometry, Angle="-0.5*pi", Plane=yz)  # -> Geometry, Transform
c_script_2 = CSharpScript(mesh=rotate.Geometry)  # -> json; inputs mesh: Mesh
# ---------- c_script_2: C# ----------
    var sb = new System.Text.StringBuilder();
    sb.AppendLine("{");
    sb.Append("  \"vertices\": [");
    for(int i = 0; i < mesh.Vertices.Count; i++)
    {
      var pt = mesh.Vertices[i];
      if( i > 0)
        sb.Append(", ");
      sb.AppendFormat("[{0:F3}, {1:F3}, {2:F3}]", pt.X, pt.Y, pt.Z);
      if( i % 3 == 2)
        sb.AppendLine();
    }
    sb.AppendLine("],");
    sb.Append("  \"normals\": [");
    for(int i = 0; i < mesh.Normals.Count; i++)
    {
      var pt = mesh.Normals[i];
      if( i > 0)
        sb.Append(", ");
      sb.AppendFormat("[{0:F3}, {1:F3}, {2:F3}]", pt.X, pt.Y, pt.Z);
      if( i % 3 == 2)
        sb.AppendLine();
    }
    sb.AppendLine("],");
    sb.Append("  \"faces\": [");
    for(int i = 0; i < mesh.Faces.Count; i++)
    {
      var face = mesh.Faces[i];
      if( i > 0)
        sb.Append(", ");
      sb.AppendFormat("[{0}, {1}, {2}]", face.A, face.B, face.C);
      if( face.IsQuad )
        sb.AppendFormat(", [{0}, {1}, {2}]", face.C, face.D, face.A);

      if( i % 3 == 2)
        sb.AppendLine();
    }
    sb.AppendLine("],");
    sb.Append("  \"colors\": [");
    for(int i = 0; i < mesh.VertexColors.Count; i++)
    {
      var color = mesh.VertexColors[i];
      if( i > 0)
        sb.Append(", ");
      sb.AppendFormat("[{0}, {1}, {2}]", color.R, color.G, color.B);

      if( i % 3 == 2)
        sb.AppendLine();
    }
    sb.AppendLine("]");
    sb.AppendLine("}");
    json = sb.ToString();
# ---------- end c_script_2 ----------
path = FilePath("/Users/will/dev/github/pearswj/rhino3dm-ar-sample/colour_mesh.js")
c_script_3 = CSharpScript(json=c_script_2, path=path)  # inputs json: String, path: String
# ---------- c_script_3: C# ----------
    System.IO.File.WriteAllText(path, json);
# ---------- end c_script_3 ----------
